# Grasshopper definition rockbot_delta-robot_kinematics_simulation.gh (Grasshopper 1.0.7)

panel = Panel("""1
4""")
targetpoint = Point([Point(121.587667, -39.49065832, -247.990417), Point(26.10479496, -39.49065832, -247.990417), Point(-68.81646488, -39.49065832, -247.990417), Point(-68.81646488, 86.99234168, -247.990417), Point(26.10479496, 86.99234168, -247.990417), Point(121.587667, 86.99234168, -247.990417)])
item = ListItem(List=targetpoint, Index=panel, Wrap=True)  # -> Item, Item1
starting_point = Point(Point(26.38560104, 23.75084168, -147.990417))

# ---- group: DROP OFF 4 LOCATION
pt = Point(<point referenced from the Rhino model>)

# ---- group: DROP OFF 3 LOCATION
pt_2 = Point(<point referenced from the Rhino model>)

# ----
geo = Geometry(item.Item)

# ---- group: DROP OFF LOCATION
pt_3 = Point(<point referenced from the Rhino model>)

# ---- group: DROP OFF 2 LOCATION
pt_4 = Point(<point referenced from the Rhino model>)

# ---- group: PICK UP LOCATION
pt_5 = Point(<point referenced from the Rhino model>)

# ---- group: PICK UP 4 LOCATION
pt_6 = Point(<point referenced from the Rhino model>)

# ---- group: PICK UP 3 LOCATION
pt_7 = Point(<point referenced from the Rhino model>)

# ----
gap = Panel("3")
z_up = Panel("40")
gripercenter_to_gripper_bottom_height = Panel("19")
addition = Addition(A=gripercenter_to_gripper_bottom_height, B=gap)
Z = UnitZ(Factor=addition)
sph = Sphere(Base=pt, Radius="5")
move = Move(Geometry=pt, Motion=Z)  # -> Geometry, Transform
Z_2 = UnitZ(Factor=z_up)
preview = CustomPreview(Geometry=sph, Material=[ColourSwatch(SwatchColor=RGB(255, 0, 255)), ColourSwatch(SwatchColor=RGB(0, 255, 255))])
graft = GraftTree(Tree=move.Geometry, IncludeEmptyLists=True, IncludeNullItems=True)
move_2 = Move(Geometry=graft, Motion=Z_2)  # -> Geometry, Transform
bottom_point = Geometry(graft)
toppoint = Geometry(move_2.Geometry)
merge = Merge(Data1=toppoint, Data2=bottom_point, Data3=toppoint)
flatten = FlattenTree(Tree=merge, Path="{0}")
panel_2 = Panel("5")  # disabled
gripper_to_delta_platform = Panel("51.344")
Z_3 = UnitZ(Factor=gripper_to_delta_platform)
Z_4 = UnitZ(Factor="100")
geo_2 = Geometry([Point(121.587667, -39.49065832, -247.990417), Point(-68.81646488, 86.99234168, -247.990417)])
move_3 = Move(Geometry=geo_2, Motion=Z_4)  # -> Geometry, Transform
topcircle = Geometry(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)
topcircle_2 = Geometry(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)
pt_8 = ConstructPoint(XCoordinate=0, YCoordinate="173", ZCoordinate="30")
move_4 = Move(Geometry=starting_point, Motion=pt_8)  # -> Geometry, Transform
point = Point(move_4.Geometry)
merge_2 = Merge(Data1=point, Data2=flatten, Data3=point)
panel_3 = Panel(merge_2)
pline = PolyLine(Vertices=merge_2, Closed=False)
divlength = DivideLength(Curve=pline, Length=panel_2)  # -> Points, Tangents, Parameters; disabled
item_2 = ListItem(List=merge_2, Index=Slider(7, range=0..10), Wrap=True)
explode = Explode(Curve=pline, Recursive=True)  # -> Segments, Vertices
panel_4 = Panel(divlength.Points)  # disabled
move_5 = Move(Geometry=explode.Vertices, Motion=Z_3)  # -> Geometry, Transform
pt_9 = Point(move_5.Geometry)
item_3 = ListItem(List=pt_9, Index=0, Wrap=True)  # -> Item, Item1
move_6 = Move(Geometry=topcircle_2, Motion=pt_8)  # -> Geometry, Transform
pt_10 = Point(Point(26.38560104, 23.75084168, 289.8457592))
move_7 = Move(Geometry=pt_10, Motion=pt_8)  # -> Geometry, Transform
Z_5 = UnitZ(Factor="-50")
move_8 = Move(Geometry=move_6.Geometry, Motion=Z_5)  # -> Geometry, Transform
pt_11 = Point(pt_9)
geo_3 = Geometry(move_8.Geometry)
gripperplane = Point(graft(pt_11))
bars = Geometry([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])
midpt = CurveMiddle(Curve=bars)
X = UnitX(Factor="43")
panel_5 = Panel("""0
120
240""")
darc = DeconstructArc(Arc=geo_3)  # -> BasePlane, Radius, Angle
avr = Average(Input=midpt)
move_9 = Move(Geometry=gripperplane, Motion=X)  # -> Geometry, Transform
panel_6 = Panel("""30
150
270""")
panel_7 = Panel("""34.159
-29.436""")
pln = Plane(darc.BasePlane)
rad = Radians(Degrees=panel_5)
vec2pt = Vector2Pt(PointA=avr, PointB=gripperplane, Unitize=False)  # -> Vector, Length
rad_2 = Radians(Degrees=panel_6)
X_2 = UnitX(Factor=panel_7)
Z_6 = UnitZ(Factor=1)
rotate = Rotate(Geometry=move_9.Geometry, Angle=rad_2, Plane=gripperplane)  # -> Geometry, Transform
sph_2 = Sphere(Base=avr, Radius="5")
move_10 = Move(Geometry=sph_2, Motion=vec2pt.Vector)  # -> Geometry, Transform
vrot = Rotate(Vector=X_2, Axis=Z_6, Angle=graft(rad))
rotate_2 = Rotate(Geometry=geo_3, Angle=rad, Plane=move_7.Geometry)  # -> Geometry, Transform
rotate_3 = Rotate(Geometry=pln, Angle=rad, Plane=move_7.Geometry)  # -> Geometry, Transform
shift = ShiftList(List=rotate.Geometry, Shift="-1", Wrap=True)  # -> simplify(List)
pt_12 = Point(rotate_3.Geometry)
preview_2 = CustomPreview(Geometry=move_10.Geometry, Material=ColourSwatch(SwatchColor=RGB(0, 0, 0)))
graft_2 = GraftTree(Tree=rotate_2.Geometry, IncludeEmptyLists=True, IncludeNullItems=True)  # -> simplify(Tree)
graft_3 = GraftTree(Tree=rotate_3.Geometry, IncludeEmptyLists=True, IncludeNullItems=True)  # -> simplify(Tree)
avr_2 = Average(Input=pt_12)
flip = FlipMatrix(Data=shift)
branch = TreeBranch(Tree=flip, Path="0", MaintainPaths=True)

servo_axis_plane = Plane(graft_3)
gripper_rod_axis_point = Geometry(flip)
servo_work_envelope_circle = Geometry(graft_2)

pt_13 = Point(flatten(servo_axis_plane))
rodlength = Panel("270")
sph_3 = Sphere(Base=gripper_rod_axis_point, Radius=rodlength)
sec = BrepPlane(Brep=sph_3, Plane=servo_axis_plane)  # -> Curves, Points
trim = TrimTree(Tree=sec.Curves, Depth=1)
points = PointList(Points=pt_13, Size=Slider(37, range=0..1000))
ccx = CurveCurve(CurveA=servo_work_envelope_circle, CurveB=trim)  # -> Points, ParamsA, ParamsB
dist = Distance(PointA=ccx.Points, PointB=avr_2)
sort = SortList(Keys=dist, ValuesA=ccx.Points)  # -> Keys, ValuesA
item_4 = ListItem(List=sort.ValuesA, Index="-1", Wrap=True)
trim_2 = TrimTree(Tree=item_4, Depth=1)
vec = Vector(simplify(vrot))
gripper_rod_axis_point_2 = Geometry(gripper_rod_axis_point)
servo_axis_plane_2 = Plane(simplify(servo_axis_plane))
servoendlocation = Plane(simplify(trim_2))
servoendlocation_2 = Plane(simplify(servoendlocation))
item_5 = ListItem(List=vec, Index=0, Wrap=True)  # -> Item, Item1
Z_7 = UnitZ(Factor="-1")
move_11 = Move(Geometry=servoendlocation_2, Motion=item_5.Item)  # -> Geometry, Transform
move_12 = Move(Geometry=servoendlocation_2, Motion=item_5.Item1)  # -> Geometry, Transform
vec2pt_2 = Vector2Pt(PointA=servoendlocation, PointB=gripper_rod_axis_point, Unitize=False)  # -> Vector, Length
move_13 = Move(Geometry=gripper_rod_axis_point_2, Motion=item_5.Item)  # -> Geometry, Transform
move_14 = Move(Geometry=gripper_rod_axis_point_2, Motion=item_5.Item1)  # -> Geometry, Transform
vec2pt_3 = Vector2Pt(PointA=servo_axis_plane_2, PointB=servoendlocation, Unitize=False)  # -> Vector, Length
angle = Angle(VectorA=Z_7, VectorB=vec2pt_3.Vector)  # -> Angle, Reflex
vdis = VectorDisplay(Anchor=servo_axis_plane_2, Vector=vec2pt_3.Vector)
vdis_2 = VectorDisplay(Anchor=servoendlocation, Vector=vec2pt_2.Vector)
ln = Line(StartPoint=move_11.Geometry, EndPoint=move_12.Geometry)
ln_2 = Line(StartPoint=move_13.Geometry, EndPoint=move_14.Geometry)
deg = Degrees(Radians=angle.Angle)
ln_3 = Line(StartPoint=move_11.Geometry, EndPoint=move_13.Geometry)
ln_4 = Line(StartPoint=move_12.Geometry, EndPoint=move_14.Geometry)
ext = ExtendCurve(Curve=[ln_3, ln_4], Type=0, Start="-3", End="-3")
pipe = Pipe(Curve=ln, Radius=1, Caps=0)  # -> flatten(Pipe)
pipe_2 = Pipe(Curve=ln_2, Radius="5", Caps=0)  # -> flatten(Pipe)
flip_2 = FlipMatrix(Data=deg)
pipe_3 = Pipe(Curve=ext, Radius="2", Caps=0)
join = TextJoin(Text=flip_2, Join=",")
flatten_2 = FlattenTree(Tree=join, Path="{0}")
preview_3 = CustomPreview(Geometry=[pipe, pipe_2], Material=ColourSwatch(SwatchColor=RGB(255, 0, 255)))
preview_4 = CustomPreview(Geometry=pipe_3, Material=ColourSwatch(SwatchColor=RGB(0, 0, 0)))
servoangle_1_2_3 = Panel(flatten_2)
